# Grasshopper definition stableDif_test00_230614.gh (Grasshopper 1.0.7)
# plug-ins: Printborg

panel = Panel("""{
"deforum_settings": {
    "W": 512,
    "H": 512,
    "show_info_on_ui": true,
    "tiling": false,
    "restore_faces": false,
    "seed_resize_from_w": 0,
    "seed_resize_from_h": 0,
    "seed": 1198998675,
    "sampler": "Euler a",
    "steps": 12,
    "batch_name": "Deforum_20231216_00",
    "seed_behavior": "iter",
    "seed_iter_N": 1,
    "use_init": true,
    "strength": 0.8,
    "strength_0_no_init": true,
    "init_image": "\"C:\\Users\\Tao\\Pictures\\wallpapers\\DSCF1774.jpg\"",
    "use_mask": false,
    "use_alpha_as_mask": false,
    "mask_file": "https://deforum.github.io/a1/M1.jpg",
    "invert_mask": false,
    "mask_contrast_adjust": 1.0,
    "mask_brightness_adjust": 1.0,
    "overlay_mask": true,
    "mask_overlay_blur": 4,
    "fill": 1,
    "full_res_mask": true,
    "full_res_mask_padding": 4,
    "reroll_blank_frames": "ignore",
    "reroll_patience": 10.0,
    "motion_preview_mode": false,
    "prompts": {
        "0": "None  tiny cute bunny, vibrant diffraction, highly detailed, intricate, ultra hd, sharp photo, crepuscular rays, in focus --neg nsfw, nude  ",
        "30": "None  anthropomorphic clean cat, surrounded by fractals, epic angle and pose, symmetrical, 3d, depth of field --neg nsfw, nude  ",
        "60": "None  a beautiful coconut --neg photo, realistic  nsfw, nude  ",
        "90": "None  a beautiful durian, award winning photography --neg nsfw, nude  "
    },
    "positive_prompts": null,
    "negative_prompts": "",
    "animation_mode": "2D",
    "max_frames": 10,
    "border": "replicate",
    "angle": "0: (0)",
    "zoom": "0: (1.0025+0.002*sin(1.25*3.14*t/30))",
    "translation_x": "0: (0)",
    "translation_y": "0: (0)",
    "translation_z": "0: (1.75)",
    "transform_center_x": "0: (0.5)",
    "transform_center_y": "0: (0.5)",
    "rotation_3d_x": "0: (0)",
    "rotation_3d_y": "0: (0)",
    "rotation_3d_z": "0: (0)",
    "enable_perspective_flip": false,
    "perspective_flip_theta": "0: (0)",
    "perspective_flip_phi": "0: (0)",
    "perspective_flip_gamma": "0: (0)",
    "perspective_flip_fv": "0: (53)",
    "noise_schedule": "0: (0.065)",
    "strength_schedule": "0: (0.65)",
    "contrast_schedule": "0: (1.0)",
    "cfg_scale_schedule": "0: (7)",
    "enable_steps_scheduling": false,
    "steps_schedule": "0: (25)",
    "fov_schedule": "0: (70)",
    "aspect_ratio_schedule": "0: (1)",
    "aspect_ratio_use_old_formula": false,
    "near_schedule": "0: (200)",
    "far_schedule": "0: (10000)",
    "seed_schedule": "0:(s), 1:(-1), \"max_f-2\":(-1), \"max_f-1\":(s)",
    "pix2pix_img_cfg_scale_schedule": "0:(1.5)",
    "enable_subseed_scheduling": false,
    "subseed_schedule": "0: (1)",
    "subseed_strength_schedule": "0: (0)",
    "enable_sampler_scheduling": false,
    "sampler_schedule": "0: (\"Euler a\")",
    "use_noise_mask": false,
    "mask_schedule": "0: (\"{video_mask}\")",
    "noise_mask_schedule": "0: (\"{video_mask}\")",
    "enable_checkpoint_scheduling": false,
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""")
path = FilePath("C:\Users\taole\source\repos\AI_Print\AI_Print\user_sketch\output\")
panel_2 = Panel("sk-KbD1s3SPXGcnNDDKkzdhSLKwPkP0GWQUtkbIsECaBj3Umeht")
panel_3 = Panel("100")

# ---- group: controlnet scribble tes
panel_4 = Panel("weird green cows")
toggle = BooleanToggle(True)  # disabled
toggle_2 = BooleanToggle(True)  # disabled
number_slider = Slider(22, range=0..50)  # disabled
models = GetControlnetModels(Send=toggle, APIAddress="http://127.0.0.1:7860")  # -> Models, Debug; disabled
modules = GetControlnetModules(Send=toggle_2, APIAddress="http://127.0.0.1:7860")  # -> Models, Debug; disabled
item = ListItem(List=modules.Models, Index=number_slider, Wrap=True)  # disabled
panel_5 = Panel("delicious apple")  # disabled
panel_6 = Panel(item)  # disabled
panel_7 = Panel(models.Models)  # disabled
path_2 = FilePath("C:\Users\taole\source\repos\Printborg\PrintborgGH\user_sketch\scribbleTest_01.png")  # disabled
panel_8 = Panel("20")  # disabled
panel_9 = Panel("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")  # disabled
panel_10 = Panel("scribble_hed")  # disabled
panel_11 = Panel("control_v11p_sd15_scribble [d4ba51ff]")  # disabled
ao_scripts = CreateAlwaysOnScripts(Model=panel_11, Module=panel_10, InputImage=panel_9)  # disabled
panel_12 = Panel("tests")  # disabled
panel_13 = Panel("128")  # disabled
path_3 = FilePath("D:\Repos\Printborg\PrintborgGH\user_sketch\output\")  # disabled
toggle_3 = BooleanToggle(True)  # disabled
a1111payload = CreateAuto1111Payload(
    Prompt=panel_5,
    NegativePrompt="bad, worse, low quality, strange, ugly",
    SamplerName="Euler",
    Steps=panel_8,
    Width=panel_13,
    Height=panel_13,
    AlwaysOnScripts=ao_scripts)  # disabled
a1111t2i = A1111TextToImageGeneration(Generate=toggle_3, APIAddress="http://127.0.0.1:7860", Payload=a1111payload, FileDirectory=path_3, FileName=panel_12)  # -> Images, Strings, Debug; disabled
img = Image(a1111t2i.Images)  # disabled
txt = Text(a1111t2i.Strings)  # disabled
panel_14 = Panel(a1111t2i.Debug)  # disabled
img_2 = Image(txt)  # disabled
txt_2 = Text(img)  # disabled
image = DisplayImage(Plane=PlaneXY(0, 0, 0), Scale=1)  # disabled
panel_15 = Panel(txt_2)  # disabled
gallery = ImageGallery(CycleDelay=30, Randomize=False, UseLocalImages=True, UseRemoteImages=True)

# ----
cyclomatron_x = SampleAsyncComponent(Generate=Button(), APIKey=panel_2, Prompt=Slider(34, range=0..100), FileDirectory=path, FileName="test1")  # -> Output, Debug, Debug_2; disabled
t2i = TextToImagePrompt(Generate=Button(), APIKey=panel_2, Prompt="weird green cows", FileDirectory=path)  # -> RawPOSTResponse, Link; disabled
panel_16 = Panel(t2i.RawPOSTResponse)
panel_17 = Panel(t2i.Link)
go_deforum = SubmitDeforumJob(Generate=Toggle(False), APIAddress="http://127.0.0.1:7860", Payload=panel)  # -> SuccessStatus, Debug
panel_18 = Panel(go_deforum.Debug)
panel_20 = Panel(go_deforum.SuccessStatus)
decon_djob = DeconstructDeforumJob(DeforumJob=go_deforum.SuccessStatus)  # -> ID, Status, Phase, Error, Progress, StartedAt, LastUpdated, ExecutionTime, Updates, Outdir
check_deforum = CheckDeforumProgress(On=Button(), APIAddress="http://127.0.0.1:7860", QueryInterval="2")  # -> Status, Phase, Progress, UpdatesCount, Debug
panel_21 = Panel(check_deforum.Status)
panel_22 = Panel(check_deforum.UpdatesCount)
panel_23 = Panel(check_deforum.Phase)
panel_24 = Panel(check_deforum.Progress)
get_djobs = GetAllDeforumJobs(APIAddress="http://127.0.0.1:7860", Submit=Button())  # -> Jobs, Debug
djob = DeforumJob(get_djobs.Jobs)
decon_djob_2 = DeconstructDeforumJob(DeforumJob=djob)  # -> ID, Status, Phase, Error, Progress, StartedAt, LastUpdated, ExecutionTime, Updates, Outdir

panel_25 = Panel(decon_djob_2.ID)
panel_26 = Panel(decon_djob_2.Status)
panel_27 = Panel(decon_djob_2.Phase)
panel_28 = Panel(decon_djob_2.Progress)
panel_29 = Panel(decon_djob_2.ExecutionTime)
panel_30 = Panel(decon_djob_2.Updates)
panel_31 = Panel(decon_djob_2.Outdir)

item_2 = ListItem(List=panel_31, Index=0, Wrap=True)
loaddirimg = LoadImagesFromDir(Directory=item_2, Scale=1)
path_4 = FilePath("D:\Repos\Printborg\PrintborgGH\user_sketch\Deforum_20230822170836\20230822170836_000000000.png")
item_3 = ListItem(List=loaddirimg, Index=0, Wrap=True)

# ----
# connect this instead!
img_3 = Image(item_3)

# ---- group: test images
path_5 = FilePath("D:\Repos\Printborg\PrintborgGH\user_sketch\Deforum_20230822170836\20230822170836_000000097.png")
path_6 = FilePath("D:\Repos\Printborg\PrintborgGH\user_sketch\bmpTest.png")
path_7 = FilePath("D:\Repos\Printborg\PrintborgGH\user_sketch\gradientTest_512_b.png")
path_8 = FilePath("D:\Repos\Printborg\PrintborgGH\user_sketch\gradientTest.png")

# ----
loadimg = LoadImage(FilePath=path_7, Scale=1)
image_2 = DisplayImage(Image=loadimg, Plane=PlaneXY(0, 0, 0), Scale=1)
mesh = Mesh(image_2)

# ---- group: generate field from colored mesh
frepmesh = FRepFromMesh(Mesh=mesh, IsoValue="0")
data_fieldtop = Data(frepmesh)

# ---- group: iso contour value
number_slider_2 = Slider(0.458, range=-20..20)

# ---- group: extract frep object as layers
mesh_layermeshes = Mesh(mesh)
numisocontourvalue = Number(number_slider_2)
data_layerfields = Data(data_fieldtop)
isoconmulti = IsoContour(Mesh=graft(mesh_layermeshes), Field=graft(data_layerfields), Tolerance=1, IsoValue=numisocontourvalue)
crv_toolpaths = Curve(isoconmulti)
