# Grasshopper definition stableDif_test01_240123.gh (Grasshopper 1.0.7)
# plug-ins: Printborg

number_slider = Slider(1, range=0..1)
panel = Panel("""{
  "sampler": "Euler a",
  "steps": 12,
  "W": 256,
  "H": 256,
  "seed": 0,
  "batch_name": "Deforum_240704_120722",
  "animation_mode": "2D",
  "diffusion_cadence": 2,
  "max_frames": 10,
  "fps": 15,
  "init_images": "{\n    \"0\": \"https://deforum.github.io/a1/Gi1.png\",\n    \"max_f/4-5\": \"https://deforum.github.io/a1/Gi2.png\",\n    \"max_f/2-10\": \"https://deforum.github.io/a1/Gi3.png\",\n    \"3*max_f/4-15\": \"https://deforum.github.io/a1/Gi4.jpg\",\n    \"max_f-20\": \"https://deforum.github.io/a1/Gi1.png\"\n}",
  "image_strength_schedule": "0:(0.75)",
  "blendFactorMax": "0:(0.35)",
  "blendFactorSlope": "0:(0.25)",
  "tweening_frames_schedule": "0:(20)",
  "prompts": {
    "0": "None  tiny cute bunny, vibrant diffraction, highly detailed, intricate, ultra hd, sharp photo, crepuscular rays, in focus --neg nsfw, nude  ",
    "30": "None  anthropomorphic clean cat, surrounded by fractals, epic angle and pose, symmetrical, 3d, depth of field --neg nsfw, nude  ",
    "60": "None  a beautiful coconut --neg photo, realistic  nsfw, nude  ",
    "90": "None  a beautiful durian, award winning photography --neg nsfw, nude  "
  },
  "positive_prompts": "",
  "negative_prompts": "",
  "strength_schedule": "",
  "cfg_scale_schedule": "",
  "seed_behavior": "iter",
  "seed_schedule": "0:(s), 1:(-1), \"max_f-2\":(-1), \"max_f-1\":(s)",
  "angle": "0: (0)",
  "zoom": "0: (1.0025+0.002*sin(1.25*3.14*t/30))",
  "translation_x": "0: (0)",
  "translation_y": "0: (0)",
  "translation_z": "0: (0)",
  "transform_center_x": "0: (0.5)",
  "transform_center_y": "0: (0.5)",
  "rotation_3d_x": "0: (0)",
  "rotation_3d_y": "0: (0)",
  "rotation_3d_z": "0: (0)",
  "show_info_on_ui": true,
  "tiling": false,
  "restore_faces": false,
  "seed_resize_from_w": 0,
  "seed_resize_from_h": 0,
  "seed_iter_N": 1,
  "use_init": true,
  "strength": 0.8,
  "strength_0_no_init": true,
  "init_image": "",
  "use_mask": false,
  "use_alpha_as_mask": false,
  "mask_file": "https://deforum.github.io/a1/M1.jpg",
  "invert_mask": false,
  "mask_contrast_adjust": 1.0,
  "mask_brightness_adjust": 1.0,
  "overlay_mask": true,
  "mask_overlay_blur": 4,
  "fill": 1,
  "full_res_mask": true,
  "full_res_mask_padding": 4,
  "reroll_blank_frames": "ignore",
  "reroll_patience": 10.0,
  "motion_preview_mode": false,
  "border": "replicate",
  "enable_perspective_flip": false,
  "perspective_flip_theta": "0: (0)",
  "perspective_flip_phi": "0: (0)",
  "perspective_flip_gamma": "0: (0)",
  "perspective_flip_fv": "0: (53)",
  "noise_schedule": "0: (0.065)",
  "contrast_schedule": "0: (1.0)",
  "enable_steps_scheduling": false,
  "steps_schedule": "0: (25)",
  "fov_schedule": "0: (70)",
  "aspect_ratio_schedule": "0: (1)",
  "aspect_ratio_use_old_formula": false,
  "near_schedule": "0: (200)",
  "far_schedule": "0: (10000)",
  "pix2pix_img_cfg_scale_schedule": "0:(1.5)",
  "enable_subseed_scheduling": false,
  "subseed_schedule": "0: (1)",
  "subseed_strength_schedule": "0: (0)",
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""")
panel_2 = Panel("""{
"deforum_settings": {
  "sampler": "Euler a",
  "steps": 12,
  "W": 512,
  "H": 512,
  "seed": 1198998675,
  "batch_name": "Deforum_240704_120722",
  "animation_mode": "2D",
  "diffusion_cadence": 2,
  "max_frames": 10,
  "fps": 15,
  "init_images": "{\n    \"0\": \"https://deforum.github.io/a1/Gi1.png\",\n    \"max_f/4-5\": \"https://deforum.github.io/a1/Gi2.png\",\n    \"max_f/2-10\": \"https://deforum.github.io/a1/Gi3.png\",\n    \"3*max_f/4-15\": \"https://deforum.github.io/a1/Gi4.jpg\",\n    \"max_f-20\": \"https://deforum.github.io/a1/Gi1.png\"\n}",
  "image_strength_schedule": "0:(0.75)",
  "blendFactorMax": "0:(0.35)",
  "blendFactorSlope": "0:(0.25)",
  "tweening_frames_schedule": "0:(20)",
  "prompts": {
    "0": "None  tiny cute bunny, vibrant diffraction, highly detailed, intricate, ultra hd, sharp photo, crepuscular rays, in focus --neg nsfw, nude  ",
    "30": "None  anthropomorphic clean cat, surrounded by fractals, epic angle and pose, symmetrical, 3d, depth of field --neg nsfw, nude  ",
    "60": "None  a beautiful coconut --neg photo, realistic  nsfw, nude  ",
    "90": "None  a beautiful durian, award winning photography --neg nsfw, nude  "
  },
  "positive_prompts": null,
  "negative_prompts": "",
  "strength_schedule": "0: (0.65)",
  "cfg_scale_schedule": "0: (7)",
  "seed_behavior": "iter",
  "seed_schedule": "0:(s), 1:(-1), \"max_f-2\":(-1), \"max_f-1\":(s)",
  "angle": "0: (0)",
  "zoom": "0: (1.0025+0.002*sin(1.25*3.14*t/30))",
  "translation_x": "0: (0)",
  "translation_y": "0: (0)",
  "translation_z": "0: (0)",
  "transform_center_x": "0: (0.5)",
  "transform_center_y": "0: (0.5)",
  "rotation_3d_x": "0: (0)",
  "rotation_3d_y": "0: (0)",
  "rotation_3d_z": "0: (0)",
  "show_info_on_ui": true,
  "tiling": false,
  "restore_faces": false,
  "seed_resize_from_w": 0,
  "seed_resize_from_h": 0,
  "seed_iter_N": 1,
  "use_init": true,
  "strength": 0.8,
  "strength_0_no_init": true,
  "init_image": "",
  "use_mask": false,
  "use_alpha_as_mask": false,
  "mask_file": "https://deforum.github.io/a1/M1.jpg",
  "invert_mask": false,
  "mask_contrast_adjust": 1.0,
  "mask_brightness_adjust": 1.0,
  "overlay_mask": true,
  "mask_overlay_blur": 4,
  "fill": 1,
  "full_res_mask": true,
  "full_res_mask_padding": 4,
  "reroll_blank_frames": "ignore",
  "reroll_patience": 10.0,
  "motion_preview_mode": false,
  "border": "replicate",
  "enable_perspective_flip": false,
  "perspective_flip_theta": "0: (0)",
  "perspective_flip_phi": "0: (0)",
  "perspective_flip_gamma": "0: (0)",
  "perspective_flip_fv": "0: (53)",
  "noise_schedule": "0: (0.065)",
  "contrast_schedule": "0: (1.0)",
  "enable_steps_scheduling": false,
  "steps_schedule": "0: (25)",
  "fov_schedule": "0: (70)",
  "aspect_ratio_schedule": "0: (1)",
  "aspect_ratio_use_old_formula": false,
  "near_schedule": "0: (200)",
  "far_schedule": "0: (10000)",
  "pix2pix_img_cfg_scale_schedule": "0:(1.5)",
  "enable_subseed_scheduling": false,
  "subseed_schedule": "0: (1)",
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""")
panel_3 = Panel("""{
"deforum_settings": {
    "W": 512,
    "H": 512,
    "show_info_on_ui": true,
    "tiling": false,
    "restore_faces": false,
    "seed_resize_from_w": 0,
    "seed_resize_from_h": 0,
    "seed": 1198998675,
    "sampler": "Euler a",
    "steps": 12,
    "batch_name": "Deforum_20231216_00",
    "seed_behavior": "iter",
    "seed_iter_N": 1,
    "use_init": true,
    "strength": 0.8,
    "strength_0_no_init": true,
    "init_image": "\"C:\\Users\\Tao\\Pictures\\wallpapers\\DSCF1774.jpg\"",
    "use_mask": false,
    "use_alpha_as_mask": false,
    "mask_file": "https://deforum.github.io/a1/M1.jpg",
    "invert_mask": false,
    "mask_contrast_adjust": 1.0,
    "mask_brightness_adjust": 1.0,
    "overlay_mask": true,
    "mask_overlay_blur": 4,
    "fill": 1,
    "full_res_mask": true,
    "full_res_mask_padding": 4,
    "reroll_blank_frames": "ignore",
    "reroll_patience": 10.0,
    "motion_preview_mode": false,
    "prompts": {
        "0": "None  tiny cute bunny, vibrant diffraction, highly detailed, intricate, ultra hd, sharp photo, crepuscular rays, in focus --neg nsfw, nude  ",
        "30": "None  anthropomorphic clean cat, surrounded by fractals, epic angle and pose, symmetrical, 3d, depth of field --neg nsfw, nude  ",
        "60": "None  a beautiful coconut --neg photo, realistic  nsfw, nude  ",
        "90": "None  a beautiful durian, award winning photography --neg nsfw, nude  "
    },
    "positive_prompts": null,
    "negative_prompts": "",
    "animation_mode": "2D",
    "max_frames": 10,
    "border": "replicate",
    "angle": "0: (0)",
    "zoom": "0: (1.0025+0.002*sin(1.25*3.14*t/30))",
    "translation_x": "0: (0)",
    "translation_y": "0: (0)",
    "translation_z": "0: (1.75)",
    "transform_center_x": "0: (0.5)",
    "transform_center_y": "0: (0.5)",
    "rotation_3d_x": "0: (0)",
    "rotation_3d_y": "0: (0)",
    "rotation_3d_z": "0: (0)",
    "enable_perspective_flip": false,
    "perspective_flip_theta": "0: (0)",
    "perspective_flip_phi": "0: (0)",
    "perspective_flip_gamma": "0: (0)",
    "perspective_flip_fv": "0: (53)",
    "noise_schedule": "0: (0.065)",
    "strength_schedule": "0: (0.65)",
    "contrast_schedule": "0: (1.0)",
    "cfg_scale_schedule": "0: (7)",
    "enable_steps_scheduling": false,
    "steps_schedule": "0: (25)",
    "fov_schedule": "0: (70)",
    "aspect_ratio_schedule": "0: (1)",
    "aspect_ratio_use_old_formula": false,
    "near_schedule": "0: (200)",
    "far_schedule": "0: (10000)",
    "seed_schedule": "0:(s), 1:(-1), \"max_f-2\":(-1), \"max_f-1\":(s)",
    "pix2pix_img_cfg_scale_schedule": "0:(1.5)",
    "enable_subseed_scheduling": false,
    "subseed_schedule": "0: (1)",
    "subseed_strength_schedule": "0: (0)",
    "enable_sampler_scheduling": false,
    "sampler_schedule": "0: (\"Euler a\")",
    "use_noise_mask": false,
    "mask_schedule": "0: (\"{video_mask}\")",
    "noise_mask_schedule": "0: (\"{video_mask}\")",
    "enable_checkpoint_scheduling": false,
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""")
createdictionary = CreateDictionary(Key="testKey", Value="testValue")
createdictionary_2 = CreateDictionary(Key="1", Value="testValue")
dict = Dictionary(createdictionary)
pro = DeforumSettingsPrompt()
run = DeforumSettingsRun(Sampler="Euler a", Steps=12, Width=256, Height=256, Seed=0)
gui = DeforumSettingsGuidedImages(
    ImageStrengthSchedule="0:(0.75)",
    BlendFactorMax="0:(0.35)",
    BlendFactorSlope="0:(0.25)",
    TweeningFramesSchedule="0:(20)")
key = DeforumSettingsKeyFrames(AnimationMode="2D", DiffusionCadence=2, MaxFrames=10, FramesPerSecond=15)
cfg = DeforumSettingsCFG()
mot = DeforumSettingsMotion(
    Angle="0: (0)",
    Zoom="0: (1.0025+0.002*sin(1.25*3.14*t/30))",
    TranslationX="0: (0)",
    TranslationY="0: (0)",
    TranslationZ="0: (0)",
    TransformCenterX="0: (0.5)",
    TransformCenterY="0: (0.5)",
    Rotation3DX="0: (0)",
    Rotation3DY="0: (0)",
    Rotation3DZ="0: (0)")
see = DeforumSettingsSeed(SeedBehaviour="iter", SeedSchedule="0:(s), 1:(-1), \"max_f-2\":(-1), \"max_f-1\":(s)")
str = DeforumSettingsStrength()
path = FilePath("C:\Users\taole\source\repos\AI_Print\AI_Print\user_sketch\output\")
panel_4 = Panel("sk-KbD1s3SPXGcnNDDKkzdhSLKwPkP0GWQUtkbIsECaBj3Umeht")
panel_5 = Panel("100")
create_dsets = CreateDeforumSettings(
    RunSettings=run,
    KeyFramesSettings=key,
    GuidedImagesSettings=gui,
    PromptSettings=pro,
    StrengthSettings=str,
    CFGSettings=cfg,
    SeedSettings=see,
    MotionSettings=mot)
cyclomatron_x = SampleAsyncComponent(Generate=Button(), APIKey=panel_4, Prompt=Slider(34, range=0..100), FileDirectory=path, FileName="test1")  # -> Output, Debug, Debug_2; disabled
t2i = TextToImagePrompt(Generate=Button(), APIKey=panel_4, Prompt="weird green cows", FileDirectory=path)  # -> RawPOSTResponse, Link; disabled
panel_6 = Panel(t2i.RawPOSTResponse)
panel_7 = Panel(t2i.Link)
go_deforum = SubmitDeforumJob(Generate=Toggle(False), APIAddress="http://127.0.0.1:7860", PayloadString=panel_2, Settings=create_dsets)  # -> SuccessStatus, Debug
panel_8 = Panel(go_deforum.Debug)
i2i_job = Image2ImageJob(go_deforum.SuccessStatus)
check_deforum = CheckDeforumProgress(On=Button(), APIAddress="http://127.0.0.1:7860", QueryInterval="2")  # -> Status, Phase, Progress, UpdatesCount, Debug
nickname = LoadFrames(IJob=i2i_job)
panel_10 = Panel(check_deforum.Status)
panel_11 = Panel(check_deforum.UpdatesCount)
panel_12 = Panel(check_deforum.Phase)
panel_13 = Panel(check_deforum.Progress)
img = Image(nickname)
item = ListItem(List=img, Index=0, Wrap=True)
decon_djob = DeconstructDeforumJob(DeforumJob=i2i_job)  # -> ID, Status, Phase, Error, Progress, StartedAt, LastUpdated, ExecutionTime, Updates, Outdir
image = DisplayImage(Image=item, Plane=PlaneXY(0, 0, 0), Scale=1)

panel_14 = Panel(decon_djob.ID)
panel_15 = Panel(decon_djob.Status)
panel_16 = Panel(decon_djob.Phase)
panel_17 = Panel(decon_djob.Progress)
panel_18 = Panel(decon_djob.ExecutionTime)
panel_19 = Panel(decon_djob.Updates)
panel_20 = Panel(decon_djob.Outdir)

item_2 = ListItem(List=panel_20, Index=0, Wrap=True)
loaddirimg = LoadImagesFromDir(Directory=item_2, Scale=1)
path_2 = FilePath("D:\Repos\Printborg\PrintborgGH\user_sketch\Deforum_20230822170836\20230822170836_000000000.png")
item_3 = ListItem(List=loaddirimg, Index=0, Wrap=True)

# ----
# connect this instead!
img_2 = Image(item_3)

# ---- group: test images
path_3 = FilePath("D:\Repos\Printborg\PrintborgGH\user_sketch\Deforum_20230822170836\20230822170836_000000097.png")
path_4 = FilePath("D:\Repos\Printborg\PrintborgGH\user_sketch\bmpTest.png")
path_5 = FilePath("D:\Repos\Printborg\PrintborgGH\user_sketch\gradientTest_512_b.png")
path_6 = FilePath("D:\Repos\Printborg\PrintborgGH\user_sketch\gradientTest.png")

# ----
loadimg = LoadImage(FilePath=path_5, Scale=1)
image_2 = DisplayImage(Image=loadimg, Plane=PlaneXY(0, 0, 0), Scale=1)
mesh = Mesh(image_2)

# ---- group: generate field from colored mesh
frepmesh = FRepFromMesh(Mesh=mesh, IsoValue="0")
data_fieldtop = Data(frepmesh)

# ---- group: iso contour value
number_slider_2 = Slider(0.458, range=-20..20)

# ---- group: extract frep object as layers
mesh_layermeshes = Mesh(mesh)
numisocontourvalue = Number(number_slider_2)
data_layerfields = Data(data_fieldtop)
isoconmulti = IsoContour(Mesh=graft(mesh_layermeshes), Field=graft(data_layerfields), Tolerance=1, IsoValue=numisocontourvalue)
crv_toolpaths = Curve(isoconmulti)
