# Grasshopper definition stableDif_test00_230614.gh (Grasshopper 1.0.7)
# plug-ins: AI_Print

path = FilePath("C:\Users\taole\source\repos\AI_Print\AI_Print\user_sketch\output\")
panel = Panel("sk-KbD1s3SPXGcnNDDKkzdhSLKwPkP0GWQUtkbIsECaBj3Umeht")
panel_2 = Panel("100")
cyclomatron_x = SampleAsyncComponent(Generate=Button(), APIKey=panel, Prompt=Slider(34, range=0..100), FileDirectory=path, FileName="test1")  # -> Output, Debug
t2i = TextToImagePrompt(Generate=Button(), APIKey=panel, Prompt="weird green cows", FileDirectory=path, FileName="test1")  # -> RawPOSTResponse, Link; disabled
panel_3 = Panel(t2i.RawPOSTResponse)
panel_4 = Panel(t2i.Link)
panel_5 = Panel(cyclomatron_x.Debug)
